# Grasshopper definition MeshToJson.gh (Grasshopper 0.9.76)
# plug-ins: MeshEdit Components, gHowl

number_slider = Slider(8, range=0..10)
msphere = MeshSphere(Base=PlaneXY(0, 0, 0), Radius=10, UCount=number_slider, VCount=number_slider)
panel = Panel("""{
"vertices": [
$VERTEX$
],
"faces": [
$FACE$
]
}""")
triangulate = MeshTriangulate(Mesh=msphere, ShortDiagonal=True)
demesh = DeconstructMesh(Mesh=triangulate)  # -> flatten(Vertices), flatten(Faces), Colours, Normals
panel_2 = Panel(demesh.Vertices)
rep = ReplaceText(Text=demesh.Faces, Find="T{", Replace="{ \"face\":[", RecursiveReplace=False)
rep_2 = ReplaceText(Text=demesh.Vertices, Find="{", Replace="{ \"vertex\":[", RecursiveReplace=False)
rep_3 = ReplaceText(Text=rep_2, Find="}", Replace="]},", RecursiveReplace=False)
rep_4 = ReplaceText(Text=rep, Find=";", Replace=",", RecursiveReplace=False)
join = TextJoin(Text=rep_3)
rep_5 = ReplaceText(Text=rep_4, Find="}", Replace="]},", RecursiveReplace=False)
join_2 = TextJoin(Text=rep_5)
rep_6 = ReplaceText(Text=panel, Find="$VERTEX$", Replace=join, RecursiveReplace=False)
panel_3 = Panel(join_2)
rep_7 = ReplaceText(Text=rep_6, Find="$FACE$", Replace=join_2, RecursiveReplace=False)
udp = UDPSender(Port=6001, Pattern=0, Data=rep_7)
panel_4 = Panel(udp)
